# Grasshopper definition 306_surface_to_slice.ghx (Grasshopper 1.0.7)
# plug-ins: Bifocals

number_slider = Slider(189, range=0..1000)
division = Division(A=number_slider, B="5")
int = Integer(division)
range = Range(Domain=Domain(0, 1), Steps=expr("x-1", int))
# I. HOW TO MAKE A STRANGE SURFACE
# Option 2 - GH Python
number_slider_2 = Slider(70, range=0..100)
graph = GraphMapper(
    range,
    x0=0,
    x1=1,
    y0=0,
    y1=1,
    amplitude=0.05347180367,
    container_name="Perlin",
    decay=0.4409280419,
    frequency=0.09208554029,
    x_offset=0.5,
    y_offset=0.5)
pt = Point(Point(484.7457627, 178.6723164, 0))
panel = Panel(graph)
python = GhPythonScript(
    srf_origin=pt,
    srf_radius=number_slider_2,
    srf_height=number_slider,
    pt_count=Slider(51, range=0..100),
    rotate=Toggle(True),
    move=Toggle(True),
    graph_map=graph)  # -> out, a, b, c; inputs srf_origin: Point3d, srf_radius: Int32, srf_height: Int32, pt_count: Int32, move: Boolean, graph_map: list
# ---------- python: Python ----------
"""
MasDfab 22-23
T1 Miniproject
How to make a strange surface

"""

import Rhino.Geometry as rg
import math
import random as r
import ghpythonlib.treehelpers as th


class MySrf(object):
    """
    this is a class that will create random patterened surface from a circle and given height
    
    """
    
    def __init__(self,pt,r,height):
        
        self.pt = pt
        self.r = r
        self.cnt = int(height/5) # change the layer height
        
        self.circles = self.get_crvs()
        self.pts = self.get_pts()
        self.srf = self.get_srf()
    
    def get_crvs(self):
        cls = []
        for i in range(self.cnt):
            origin = self.pt.Clone()  # why clone instead of deepcopy?
            rg.Point3d.Clone(
            T = rg.Transform.Translation(0,0,i*5)
            origin.Transform(T)
            c = rg.Circle(origin,self.r*graph_map[i])
            cls.append(c)
        return cls
    
    def get_pts(self):
        all_pts = []
        for i in self.circles:
            pts = []
            crv = i.ToNurbsCurve(2,5)
            params = crv.DivideByCount(pt_count,True)
            pts = [crv.PointAt(i) for i in params]
            all_pts.append(pts)
        if rotate:
            self.rotate_pts(all_pts)
        if move:
            self.move_pts(all_pts)
        
        return all_pts

    def rotate_pts(self,pts):
        r_step = 0
        for lists, origin in zip(pts, self.circles):
            r_step += (math.pi/2)/self.cnt
            for pt in lists:
                T = rg.Transform.Rotation(r_step,origin.Center)
                pt.Transform(T)
    
    def move_pts(self,pts):
        for lists,origins in zip(pts,self.circles):
            for pt in lists:
                vec = pt-origins.Center
                vec.Unitize()   # get 1 unit of vector so if u input different geometries it would not affect the amplitude
                T = rg.Transform.Translation(vec * r.uniform(0,7.0))
                pt.Transform(T)
    
    def get_srf(self):
        crvs = []
        for layers in self.pts:
            layers.append(layers[0])
            crv = rg.Curve.CreateInterpolatedCurve(layers,3)
            crvs.append(crv)
        srf = rg.Brep.CreateFromLoft(crvs,rg.Point3d.Unset,rg.Point3d.Unset,rg.LoftType(0),False)
        return srf


s = MySrf(srf_origin, srf_radius, srf_height)

a = s.circles
b = th.list_to_tree(s.pts)
c = s.srf
# ---------- end python ----------
brep = Brep(python.c)
crv = Curve(python.a)
pt_2 = Point(python.b)
cap = CapHoles(Brep=brep)

preview = CustomPreview(Geometry=cap, Material=ColourSwatch(SwatchColor=RGBA(84, 189, 200, 178)))

# ----
# II. HOW TO SLICE A STRANGE SURFACE
# Option 2 - GH Python
number_slider_3 = Slider(80, range=0..100)
python_2 = GhPythonScript(brep=cap, layer_height="3", count=number_slider_3, shift=Toggle(True), p=Slider(4, range=0..10))  # -> out, slice_crvs, slice_pts, first_pts, safe_pts, parts_list; inputs brep: Brep, layer_height: Int32, count: Int32, shift: Boolean, p: Int32
# ---------- python_2: Python ----------
"""
MasDfab 22-23
T1 Miniproject
How to slice a strange surface

"""

import Rhino
import Rhino.Geometry as rg
import ghpythonlib.treehelpers as th


# get rhino's zero zolerance constant, which is 2^-32.
zero = Rhino.RhinoMath.ZeroTolerance

def slice_brep(brep, layer_thickness):
    """
    this function will slice the closed brep and return the curves
    brep:   any closed brep
    layer height:   layer height
    """
    # get the min_z, max_z and height
    brep_bounding_box = brep.GetBoundingBox(rg.Plane.WorldXY)

    max_x, max_y, max_z = brep_bounding_box.Max
    min_x, min_y, min_z = brep_bounding_box.Min
    
    # intersect brep with a series of planes 
    slice_crvs = []
    
    height = min_z
    
    for i in range (1000):
        height += layer_thickness
        if height < max_z:
            intersection_plane = rg.Plane(rg.Point3d(0,0, height), rg.Vector3d.XAxis, rg.Vector3d.YAxis)
            intersection_events = rg.Intersect.Intersection.BrepPlane(brep, intersection_plane, zero)

            # if intersection is True
            if intersection_events[0]:
                # append the intersection curve into the list
                for crv in intersection_events[1]:
                    slice_crvs.append(crv)
            # if intersection is false, then print this message
            else:
                print "sorry, intersection went wrong"
                
        # if the height has reached the max_z of value of the brep, then break 
        else:
            break
        
    return slice_crvs

def slice_pts(crvs, count):
    """
    this function will divide the sliced curves into points and return them
    
    crvs:   list of sliced curves
    count:  divide the curves by count
    """
    
    pts =  []

    for crv in crvs:
    # iterate through the curves, and check the orientation, if any is counterclockwise - then reverse it
    #make sure the extrude goes in a nice way
        orientation = crv.ClosedCurveOrientation()
        if (orientation == rg.CurveOrientation.CounterClockwise):
            crv.Reverse()
    
    # divide the curve by count
        params = crv.DivideByCount(count, True)
        layer_pts = []
    
        for p in params:
            pt = crv.PointAt(p)
            layer_pts.append(pt)
        
        pts.append(layer_pts)
        
    # if we need to shift the curve seam
    if shift:
        new_pts = []
        print ("shift")
        k = 0
        for list in pts:
            k += 1
            if k > len(list):
                k = k - len(list)
            list = list[k:] + list[:k]  #shif in py means list slicing   [1,2,3,4,5]  [1:]+...+[:1]= [2,3,4,5,1]
            new_pts.append(list)
        pts = new_pts
    return pts

def safe_pts (crvs, pts):
    """
    this function will return the first drag point and last safe point = "home position"
    
    crvs:   list of sliced curves
    pts:    nested list of points that curves were divided with
    """
    
    # the first point "dragging" point
    crv = slice_crvs[0]
    pt_zero = slice_pts[0][0].Clone()
    
    t = crv.TangentAt(rg.Curve.ClosestPoint(crv,pt_zero)[0])
    v = rg.Vector3d.CrossProduct(rg.Vector3d.ZAxis,t)
    pt_zero.Transform(rg.Transform.Translation(v*50))
    
    # the last point is the center of curve
    crv_last = slice_crvs[-1]
    b = crv_last.GetBoundingBox(rg.Plane.WorldXY)
    pt_last = b.Center
    pt_last.Transform(rg.Transform.Translation(rg.Vector3d.ZAxis * 50))
    
    return [pt_zero, pt_last]
    pass

# slicing brep and getting slicing crvs out
slice_crvs = slice_brep(brep,layer_height)

# diving the curves into points and getting nested list out
slice_pts = slice_pts(slice_crvs, count)

# getting the point zero and last point
safe_pts = safe_pts(slice_crvs, slice_pts)

## extra steps: extending the list with safe points
flat_list = [j for i in slice_pts for j in i]   #for i in 
flat_list.insert(0, safe_pts[0])
flat_list.append(safe_pts[1])
## extra steps: and slicing for fabrication
t = 1000

parts_list = [i for i in flat_list[(p*t):(p*t+t)]]
##### p comes from the external variable, partiton list means slice in py

first_pts = [i[0] for i in slice_pts]
slice_pts = th.list_to_tree(slice_pts)
# ---------- end python_2 ----------
geo = Geometry(python_2.slice_crvs)
pt_3 = Point(python_2.slice_pts)
pt_4 = Point(python_2.first_pts)
pt_5 = Point(python_2.safe_pts)

point = Point(python_2.parts_list)
xy = XYPlane(Origin=pt_3)

pln = Plane(xy)
preview_2 = CustomPreview(Geometry=pln, Material=ColourSwatch(SwatchColor=RGBA(84, 189, 200, 178)))

layer_height = Slider(6, range=0..10)
layer_count = Slider(30, range=0..100)
# I. HOW TO MAKE A STRANGE SURFACE
# Option 1 - GH
number_slider_4 = Slider(48, range=0..100)
series = Series(Start=0, Step=layer_height, Count=layer_count)
pt_6 = Point(Point(164.6892655, 178.6723164, 0))
cir = Circle(Plane=pt_6, Radius=number_slider_4)
Z = UnitZ(Factor=series)
div_pt_count = Slider(60, range=0..60)
move = Move(Geometry=cir, Motion=Z)  # -> Geometry, Transform
area = Area(Geometry=move.Geometry)  # -> Area, graft(Centroid)
divide = DivideCurve(Curve=move.Geometry, Count=div_pt_count, Kinks=False)  # -> Points, Tangents, Parameters

# ---- group: OVERALL SHAPE
radians = Slider(1.45, range=0..2)
pi = Pi(Factor=radians)
dom = ConstructDomain(DomainStart=Slider(0.1, range=0..1), DomainEnd=1)
division_2 = Division(A=pi, B=layer_count)
range_2 = Range(Domain=dom, Steps=expr("x-1", layer_count))
series_2 = Series(Start=0, Step=division_2, Count=layer_count)
graph_2 = GraphMapper(
    range_2,
    x0=0,
    x1=1,
    y0=0,
    y1=1,
    amplitude=0.05347180367,
    container_name="Perlin",
    decay=0.4409280419,
    frequency=0.09208554029,
    x_offset=0.5,
    y_offset=0.5)
rotate = Rotate(Geometry=divide.Points, Angle=graft(series_2), Plane=area.Centroid)  # -> Geometry, Transform
dom_2 = ConstructDomain(DomainStart=0, DomainEnd=Slider(1.6, range=0..10))
remap = RemapNumbers(Value=graph_2, Source=Domain(0, 1), Target=dom_2)  # -> Mapped, Clipped
scale = Scale(Geometry=rotate.Geometry, Center=area.Centroid, Factor=graft(remap.Mapped))  # -> Geometry, Transform

# ----
panel_2 = Panel(pi)

# ---- group: SKIN
start = Slider(0, range=-10..0)
end = Slider(5.4, range=0..10)
seed = Slider(60, range=0..100)
dom_3 = ConstructDomain(DomainStart=start, DomainEnd=end)
lng = ListLength(List=flatten(scale.Geometry))
random = Random(Range=dom_3, Number=lng, Seed=seed)
vec2pt = Vector2Pt(PointA=area.Centroid, PointB=scale.Geometry, Unitize=False)  # -> Vector, Length
partition = PartitionList(List=random, Size=div_pt_count)
unit = UnitVector(Vector=vec2pt.Vector)
multiplication = Multiplication(A=partition, B=unit)

# ----
vdis = VectorDisplay(Anchor=scale.Geometry, Vector=unit)
move_2 = Move(Geometry=scale.Geometry, Motion=multiplication)  # -> Geometry, Transform
intcrv = Interpolate(Vertices=move_2.Geometry, Degree=3, Periodic=True, KnotStyle=1)  # -> Curve, Length, Domain
loft = Loft(
    Curves=flatten(intcrv.Curve),
    Options={Adjust=False, Closed=False, LoftEnds=0, LoftSimp=0, LoftType=0, Rebuild=10, Refit=0.01})
cap_2 = CapHoles(Brep=loft)

preview_3 = CustomPreview(Geometry=cap_2, Material=ColourSwatch(SwatchColor=RGBA(55, 19, 151, 178)))

# ---- group: INPUT
# II. HOW TO SLICE A STRANGE SURFACE
# Option 1 - GH
center_points = Point(area.Centroid)
closed_brep = Brep(cap_2)
layer_height_2 = Number("3")
base_point = Point(pt_6)

# ---- group: END POINT
item = ListItem(List=flatten(center_points), Index="-1", Wrap=True)
Z_2 = UnitZ(Factor=Slider(65, range=0..100))
move_3 = Move(Geometry=item, Motion=Z_2)  # -> Geometry, Transform
pt_7 = Point(move_3.Geometry)

# ---- group: SLICE YOUR OBJECT
xy_2 = XYPlane(Origin=base_point)
contour = Contour(Shape=closed_brep, Point=xy_2, Direction=Vector(0, 0, 1), Distance=layer_height_2)

# ---- group: SHIFT SEAM
lng_2 = ListLength(List=flatten(contour))
divide_2 = DivideCurve(Curve=contour, Count=Slider(100, range=0..100), Kinks=False)  # -> Points, Tangents, Parameters
series_3 = Series(Start=0, Step=1, Count=lng_2)
shift = ShiftList(List=divide_2.Points, Shift=graft(series_3), Wrap=True)  # -> simplify(List)
filter = StreamFilter(Gate=Toggle(False), Stream0=divide_2.Points, Stream1=shift)

# ---- group: START POINT
branch = TreeBranch(Tree=simplify(divide_2.Points), Path="0", MaintainPaths=True)
pline = PolyLine(Vertices=branch, Closed=True)
item_2 = ListItem(List=branch, Index=0, Wrap=True)
crv_cp = CurveClosestPoint(Point=item_2, Curve=pline)  # -> Point, Parameter, Distance
eval = EvaluateCurve(Curve=pline, Parameter=crv_cp.Parameter)  # -> Point, Tangent, Angle
Z_3 = UnitZ(Factor=1)
xprod = CrossProduct(VectorA=Z_3, VectorB=eval.Tangent, Unitize=False)  # -> Vector, Length
vdis_2 = VectorDisplay(Anchor=eval.Point, Vector=xprod.Vector)
multiplication_2 = Multiplication(A=xprod.Vector, B=Slider(50, range=0..100))
move_4 = Move(Geometry=eval.Point, Motion=multiplication_2)  # -> Geometry, Transform

# ----
all_points = Point(filter)

# ---- group: INSERT START AND END POINT
panel_3 = Panel("""0
-1""")
ins = InsertItems(List=flatten(all_points), Item=[move_4.Geometry, pt_7], Indices=panel_3, Wrap=True)

# ----
final_pts = Point(ins)
lng_3 = ListLength(List=ins)
panel_4 = Panel(lng_3)

# ---- group: PARTITION PLANES
partition_2 = PartitionList(List=final_pts, Size=Slider(1000, range=0..1000))
branch_2 = TreeBranch(Tree=simplify(partition_2), Path=Slider(0, range=0..5), MaintainPaths=True)

# ----
xy_3 = XYPlane(Origin=branch_2)

pln_2 = Plane(xy_3)
preview_4 = CustomPreview(Geometry=pln_2, Material=ColourSwatch(SwatchColor=RGBA(55, 19, 151, 178)))
