# Grasshopper definition 3_different_attractors.ghx (Grasshopper 1.0.7)

file_path = FilePath("C:\Users\24420\Documents\GitHub\Brick-wall\3_different_attractors.py")
read_file = ReadFile(File=file_path, PerLineParse=False)  # -> Content
#   port File: Uri of file to read
# ---------- read_file: VB line parser ----------
    action = GH_LineParserAction.Include
    Return line

    'Parse the line and return some data that represents the line.
    'If the line cannot be parsed, you can return Nothing and
    'assign a different action.
    'The default implementation is to just return the line itself.
    'If you return types that implement IGH_Goo, this component
    'will work substantially faster.
# ---------- end read_file ----------
radians = Radians(Degrees=Slider(178, range=0..1000))
curve = Curve(<curve referenced from the Rhino model>)
point = Point(<point referenced from the Rhino model>)
curve_2 = Curve(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)
ghpython_script = GhPythonScript(
    Code=read_file,
    Curve=curve_2,
    Layer_num=Slider(29, range=0..100),
    Gap=Slider(4, range=0..10),
    Length=Slider(27, range=0..100),
    Width=Slider(15, range=0..100),
    Height=Slider(10, range=0..10),
    Type=Slider(0, range=0..3),
    Attract_curve=curve,
    Attract_point=point,
    Scale=Slider(3, range=0..10),
    Max=Slider(5, range=0..10),
    Min=Slider(2, range=0..10),
    Angle=radians)  # -> Out, New_planes, Bricks, Crvs, A, T_points, Planes, T_values
plane = Plane(ghpython_script.New_planes)
box = Box(ghpython_script.Bricks)
plane_2 = Plane(ghpython_script.Planes)
planeaxis = PlaneAxis(P=plane, B=35)
panel = Panel(ghpython_script.T_values)

# ==== cluster PlaneAxis: show plane X Y Z axis.
P = ClusterInput()
B = ClusterInput()
deplane = DeconstructPlane(Plane=graft(P))  # -> Origin, XAxis, YAxis, ZAxis
multiplication = Multiplication(A=[deplane.XAxis, deplane.YAxis, deplane.ZAxis], B=B)
vdisex = VectorDisplayEx(
    Point=deplane.Origin,
    Vector=multiplication,
    Colour=[ColourSwatch(SwatchColor=RGB(235, 52, 52)), ColourSwatch(SwatchColor=RGB(90, 207, 48)), ColourSwatch(SwatchColor=RGB(54, 126, 227))],
    Width=2)
